# Grasshopper definition Rocket_Design.gh (Grasshopper 1.0.7)
# plug-ins: Bifocals

atmospheric_pressure_mpa = Slider(0.07584, range=0..10)
initial_mass_of_missle_kg = Slider(332.35, range=0..1000)
exit_dia = Slider(0.91, range=0..2)
throat_dia = Slider(0.226, range=0..100)
nozzle_effeciency_e = Slider(0, range=0..100)
initial_thrust_n = Slider(2224.1, range=0..10000)
mission_delta_v = Slider(550, range=0..1000)
intial_po_mpa = Slider(12.41, range=0..100)
list = ValueList({"Internal(Center) Burning Tube": 1, "End Grain": 2, "Internal- External Burning Tube": 2² - 1, "Rod and Tube": Sqrt(16)}, selected="Internal(Center) Burning Tube")
a_throat_cross_section = CSharpScript(Throat_Diameter_d=throat_dia)  # -> out, A_A_star; inputs Throat_Diameter_d: Double
# ---------- a_throat_cross_section: C# ----------
    A = Math.Round((Math.PI / 4) * Math.Pow(d, 2), 5);
# ---------- end a_throat_cross_section ----------
a_throat_cross_section_2 = CSharpScript(Throat_Diameter_d=exit_dia)  # -> out, A; inputs Throat_Diameter_d: Double; same code as a_throat_cross_section
list_2 = ValueList({"60% Bell Contour": .60, "80% Bell Contour": .80, "15-deg Cone": 1}, selected="15-deg Cone")
thrust_equation = CSharpScript(Pressure_at_Nozzle_Exit_Pe=mission_delta_v, Ambient_Pressure_Pa=initial_mass_of_missle_kg)  # -> out, A, B; inputs Thrust_F: Double, Propellant_Mass_Flow_Rate_m_dot: Double, Velocity_of_Exit_Gases_Ve: Double, Pressure_at_Nozzle_Exit_Pe: Double, Ambient_Pressure_Pa: Double, Area_of_Nozzle_Exit_Ae: Double
# ---------- thrust_equation: C# ----------
    if (F == 0){
      F = (m_dot * Ve + (Pe - Pa) * Ae);
    }
    if(Pe > Pa){
      B = "Under Extended";
    }
    if(Pe == Pa){
      B = "Fully Extended";
    }
    if(Pe < Pa){
      B = "Over-Extended";
    }
    A = F.ToString();
# ---------- end thrust_equation ----------
c_script = CSharpScript()  # -> out, A; inputs Outer_Diameter_D: Double, Volumetric_Loading_Fraction_V: Double, Cross_Section_Throat_At: Double
# ---------- c_script: C# ----------
    A = (((Math.PI) * Math.Pow(D,2) * (1 - V)) / (4 * At));
# ---------- end c_script ----------
throat_cross_section_area = Panel(a_throat_cross_section.A_A_star)
c_script_2 = CSharpScript(Area_of_Nozzle_Exit_Ae=a_throat_cross_section_2.A, Area_of_Nozzle_Throat_At=a_throat_cross_section.A_A_star)  # -> out, A_Expansion; inputs Area_of_Nozzle_Exit_Ae: Double, Area_of_Nozzle_Throat_At: Double
# ---------- c_script_2: C# ----------
    A_Expansion = (Ae / At);
# ---------- end c_script_2 ----------
exit_cross_section_area = Panel(a_throat_cross_section_2.A)
solid_rocket_flow_rate = CSharpScript()  # -> out, A; inputs Mass_Density_Pb: Double, Burning_Area_Ab: Double, Burn_Rate_r: Double
# ---------- solid_rocket_flow_rate: C# ----------
    A = (Pb * Ab * r);
# ---------- end solid_rocket_flow_rate ----------
c_script_3 = CSharpScript()  # -> out, A; inputs Mass_Initial_Mi: Double, Mass_Final_Mf: Double, Velocity_Ve: Double
# ---------- c_script_3: C# ----------
    A = Ve * Math.Log(Mi / Mf);
# ---------- end c_script_3 ----------
c_script_4 = CSharpScript(Nozzle_Throat_Radius_Rt=throat_dia, Nozzle_Exit_Radius_Re=exit_dia, Nozzle_Type_theta=list_2)  # -> out, A; inputs Nozzle_Throat_Radius_Rt: Double, Nozzle_Exit_Radius_Re: Double, Nozzle_Type_theta: Double
# ---------- c_script_4: C# ----------
    A = (Re - Rt) / Math.Tan(15 * (Math.PI / 180)) * theta;
# ---------- end c_script_4 ----------
delta_v = Panel(c_script_3.A)
thrust_n = Panel(thrust_equation.A)
nozzle_state = Panel(thrust_equation.B)
propellant_grain_flow_rate = Panel(solid_rocket_flow_rate.A)
port_to_throat = Panel(c_script.A)
nozzle_length_m = Panel(c_script_4.A)
exspansion_ratio = Panel(c_script_2.A_Expansion)
number_slider = Slider(0.533, range=0..10)
number_slider_2 = Slider(0.32, range=0..10)
mass_flowrate_m = Slider(1756.429, range=0..10000)
c_script_5 = CSharpScript(
    Pressure_Chamber_p=Slider(1598.157, range=0..10000),
    Throat_Area_a=Slider(2038.226, range=0..10000),
    Mass_Flowrate_m=mass_flowrate_m)  # -> out, A_C_star; inputs Pressure_Chamber_p: Double, Throat_Area_a: Double, Mass_Flowrate_m: Double
# ---------- c_script_5: C# ----------
    A = ((p * a) / m);
# ---------- end c_script_5 ----------
c_script_6 = CSharpScript(Outer_Diamter_Do=number_slider, Inner_Diameter_Di=number_slider_2)  # -> out, A_Web_Thickness; inputs Outer_Diamter_Do: Double, Inner_Diameter_Di: Double
# ---------- c_script_6: C# ----------
A=((Do - Di) / 2);
# ---------- end c_script_6 ----------
c_script_7 = CSharpScript(Outer_Diameter_OD=number_slider, Inner_Diameter_ID=number_slider_2, Length_L=Slider(4.53, range=0..100))  # -> out, A, B, C; inputs Outer_Diameter_OD: Double, Inner_Diameter_ID: Double, Length_L: Double
# ---------- c_script_7: C# ----------
    A = Math.Round((Math.PI / 4 * (Math.Pow(OD, 2) - Math.Pow(ID, 2)) * L), 5);
    B = Math.Round((L / OD), 1);
   // C = // Loading The Volumetric Loading Fraction is defined as the fraction of grain volume to available chamber volume, and relates the volumetric efficiency of the motor, as well as a measure of performance efficiency:
   // D=// Web Thickness
   // E= // Port to Throat Area Ratio
# ---------- end c_script_7 ----------
panel = Panel(c_script_5.A_C_star)
casing_volume = Panel(c_script_7.A)
l_d_ratio = Panel(c_script_7.B)
panel_2 = Panel(c_script_7.C)
web_thickness = Panel(c_script_6.A_Web_Thickness)
